# Grasshopper definition LineDrawing.gh (Grasshopper 1.0.8)
# plug-ins: RhinoCodePluginGH, Human

dpipeline = DynamicGeometryPipeline(
    LayerFilter="Layer 01",
    TypeFilter="Curve",
    NameFilter="*",
    GroupByLayer=False,
    GroupByType=False,
    IncludeHidden=True,
    IncludeLocked=True,
    enableFullPath=False,
    listenToAttributes=True)
dpipeline_2 = DynamicGeometryPipeline(
    LayerFilter="Layer 04",
    TypeFilter="Curve",
    NameFilter="*",
    GroupByLayer=False,
    GroupByType=False,
    IncludeHidden=True,
    IncludeLocked=True,
    enableFullPath=False,
    listenToAttributes=True)
panel = Panel("""Brep
Extrusion""")
explode = Explode(Curve=dpipeline_2, Recursive=True)  # -> Segments, Vertices
viewports = QueryViewports(Name="ABC", AutoUpdateState=True)
dpipeline_3 = DynamicGeometryPipeline(
    LayerFilter="Layer 04",
    TypeFilter=panel,
    NameFilter="*",
    GroupByLayer=False,
    GroupByType=False,
    IncludeHidden=True,
    IncludeLocked=True,
    enableFullPath=False,
    listenToAttributes=True)
crv = Curve([<curve referenced from the Rhino model> x11])
l0 = Start(1)
dom = ConstructDomain(DomainStart=Slider(1, range=-5..5), DomainEnd=Slider(2, range=-5..5))
make2d = Make2D(Geometry=dpipeline_3, View=viewports, TangentEdges=False, TangentSeams=False, AutoComputeMake2D=True)  # -> VisibleCurves, VisibleIndex, VisibleType, HiddenCurves, HiddenIndex, HiddenType
number_slider = Slider(0.5, range=0..10)
crv_2 = Curve([<curve referenced from the Rhino model> x24])
crv_3 = Curve(make2d.VisibleCurves)
dom_2 = ConstructDomain(DomainStart=expr("-x", number_slider), DomainEnd=expr("x", number_slider))
lng = ListLength(List=crv_2)
lng_2 = ListLength(List=crv_2)
dom_3 = ConstructDomain(DomainStart=Slider(-5, range=-5..5), DomainEnd=Slider(0, range=-5..5))
X = UnitX(Factor=5000)
scale = Scale(Geometry=crv_3, Center=Point(0, 0, 0), Factor=0.5)  # -> Geometry, Transform
random = Random(Range=Domain(0, 1), Number=lng, Seed=7456)
random_2 = Random(Range=Domain(0, 1), Number=lng_2, Seed=234)
move = Move(Geometry=scale.Geometry, Motion=X)  # -> Geometry, Transform
ext = ExtendCurve(Curve=move.Geometry, Type=0, Start=l0, End=l0)
lng_3 = ListLength(List=ext)
lng_4 = ListLength(List=ext)
random_3 = Random(Range=Domain(0, 1), Number=lng_3, Seed=7456)
random_4 = Random(Range=Domain(0, 1), Number=lng_4, Seed=234)
remap = RemapNumbers(Value=random_4, Source=Domain(0, 1), Target=dom)  # -> Mapped, Clipped
remap_2 = RemapNumbers(Value=random_3, Source=Domain(0, 1), Target=dom)  # -> Mapped, Clipped
ext_2 = ExtendCurve(Curve=ext, Type=0, Start=remap.Mapped, End=remap_2.Mapped)
lng_5 = ListLength(List=ext_2)
hframe = HorizontalFrame(Curve=reparameterize(ext_2), Parameter=0.5)
random_5 = Random(Range=dom_2, Number=lng_5, Seed=2)
remap_3 = RemapNumbers(Value=random_2, Source=Domain(0, 1), Target=dom_3)  # -> Mapped, Clipped
remap_4 = RemapNumbers(Value=random, Source=Domain(0, 1), Target=dom_3)  # -> Mapped, Clipped
rotate = Rotate(Geometry=ext_2, Angle=degrees(random_5), Plane=hframe)  # -> flatten(Geometry), Transform
ext_3 = ExtendCurve(Curve=crv_2, Type=0, Start=remap_3.Mapped, End=remap_4.Mapped)
number_slider_2 = Slider(2, range=0..50)
Y = UnitY(Factor=1)
pt = ConstructPoint(XCoordinate=0, YCoordinate=0, ZCoordinate=0)
amp = Amplitude(Vector=Y, Amplitude=expr("-x/2", number_slider_2))
line = LineSDL(Start=pt, Direction=Y, Length=number_slider_2)
hframe_2 = HorizontalFrame(Curve=reparameterize(ext_3), Parameter=0)
move_2 = Move(Geometry=line, Motion=amp)  # -> Geometry, Transform
orient = Orient(Geometry=move_2.Geometry, Source=PlaneXY(0, 0, 0), Target=hframe_2)  # -> Geometry, Transform
panel_2 = Panel("X:\93_Development\graphicSamples\Artline200_Fine_0.4_Freehand")
swp1 = Sweep1(Rail=graft(ext_3), Sections=graft(orient.Geometry), Miter=1)
number_slider_3 = Slider(2.49, range=0..50)
dir = DirectoryContents(FolderPath=panel_2, Filter="*", IncludeSubfolders=False)  # -> FilePaths, FileNames
object = ModelObject(Geometry=swp1)  # -> Object, Geometry, Name, Layer, Visibility, Display, Drafting, Render
split = TextSplit(Text=dir.FileNames, Separators="mm")
len = Length(Curve=rotate.Geometry)
bnd = Bounds(Numbers=len)
dedomain = DeconstructDomain(Domain=bnd)  # -> Start, End
Y_2 = UnitY(Factor=1)
pt_2 = ConstructPoint(XCoordinate=0, YCoordinate=0, ZCoordinate=0)
cache = ContentCache(Content=object.Object)
eval = EvaluateLength(Curve=rotate.Geometry, Length=0, Normalized=True)  # -> Point, Tangent, Parameter
panel_3 = Panel("""0
9
16
23
28
34
40
47
52
59
65
72
80
83
90
99
106""")
item = ListItem(List=split, Index=0, Wrap=True)
amp_2 = Amplitude(Vector=Y_2, Amplitude=expr("-x/2", number_slider_3))
line_2 = LineSDL(Start=pt_2, Direction=Y_2, Length=number_slider_3)
remap_5 = RemapNumbers(Value=len, Source=dedomain.End, Target=Domain(0, 214.9))  # -> Mapped, Clipped
xy = XYPlane(Origin=eval.Point)
int = Integer(item)
move_3 = Move(Geometry=line_2, Motion=amp_2)  # -> Geometry, Transform
align = AlignPlane(Plane=xy, Direction=eval.Tangent)  # -> Plane, Angle
clean = CleanTree(RemoveNulls=True, RemoveInvalid=True, RemoveEmpty=True, Tree=int)  # -> flatten(Tree)
orient_2 = Orient(Geometry=move_3.Geometry, Source=PlaneXY(0, 0, 0), Target=align.Plane)  # -> Geometry, Transform
sort = SortList(Keys=clean, ValuesA=clean)  # -> Keys, ValuesA
int_2 = Integer(0)
Z = UnitZ(Factor=1)
cset = CreateSet(List=sort.ValuesA)  # -> Set, Map
swp1_2 = Sweep1(Rail=graft(rotate.Geometry), Sections=graft(orient_2.Geometry), Miter=1)  # -> simplify(Brep)
merge = Merge(Data1=flatten(int_2), Data2=flatten(cset.Set))
consec = ConsecutiveDomains(Numbers=merge, Additive=False)
fdom = FindDomain(Domains=consec, Number=remap_5.Mapped, Strict=False)  # -> Index, Neighbour
item_2 = ListItem(List=consec, Index=fdom.Index, Wrap=True)
dedomain_2 = DeconstructDomain(Domain=item_2)  # -> Start, End
cset_2 = CreateSet(List=dedomain_2.End)  # -> Set, Map
material = CreateMaterial(
    Diffuse=ColourSwatch(SwatchColor=RGB(0, 0, 0)),
    Specular=RGB(255, 255, 255),
    Emission=RGB(0, 0, 0),
    Transparency=0,
    Shine=0)
move_4 = Move(Geometry=swp1_2, Motion=Z)  # -> Geometry, Transform
ipy2 = IronPython2Script(x=cset_2.Set)  # -> out, a; disabled
# ---------- ipy2: IronPython ----------
import Rhino 
import scriptcontext as sc

sc.doc = Rhino.RhinoDoc.ActiveDoc

bmtex = Rhino.Render.RenderContentType.NewContentFromTypeId(Rhino.Render.ContentUuids.BitmapTextureType)
bmtex.Filename = r"X:\93_Development\graphicSamples\Artline200_Fine_0.4_Freehand\%03dmm-000.png"%(x)

simtex = bmtex.SimulatedTexture(Rhino.Render.RenderTexture.TextureGeneration.Allow)

#
#print(Rhino.Render.ContentUuids.PhysicallyBasedMaterialType)

# first create an empty PBR material
pbr_rm = Rhino.Render.RenderContentType.NewContentFromTypeId(Rhino.Render.ContentUuids.PhysicallyBasedMaterialType)

# to get to a Rhino.DocObjects.PhysicallyBasedMaterial we need to simulate the
# render material first.
sim = pbr_rm.SimulatedMaterial(Rhino.Render.RenderTexture.TextureGeneration.Allow)

# from the simulated material we can get the Rhino.DocObjects.PhysicallyBasedMaterial
pbr = sim.PhysicallyBased;

# now we have an instance of a type that has all the API you need to set the PBR
# properties. For simple glass we set color to white, opacity to 0 and opacity
# IOR to 1.52
pbr.Opacity = 1.0
pbr.OpacityIOR = 1.52
pbr.BaseColor = Rhino.Display.Color4f.Black

print(dir(pbr))
print(pbr.SetTexture.__doc__)
print(dir(Rhino.DocObjects.TextureType))
#PBR_Alpha
#pbr.SetTexture(simtex.Texture(), Rhino.DocObjects.TextureType.PBR_BaseColor)
pbr.SetTexture(simtex.Texture(), Rhino.DocObjects.TextureType.PBR_Alpha)

# convert it back to RenderMaterial
new_pbr = Rhino.Render.RenderMaterial.FromMaterial(pbr.Material, sc.doc)
# Set a good name
new_pbr.Name = str(int(x))

# Add it to the document
sc.doc.RenderMaterials.Add(new_pbr)

sc.doc = ghdoc
# ---------- end ipy2 ----------
materials = QueryModelMaterials(Name=cset_2.Set, AutoUpdateState=True)  # -> flatten(Materials)
series = Series(Start=0, Step=1, Count=2)
int_3 = Integer(1)
item_3 = ListItem(List=materials, Index=cset_2.Map, Wrap=True)
int_4 = Integer(1)
object_material = RenderMaterial(Source=1, Material=item_3)  # -> ObjectMaterial, Source, Material
render = RenderAttributes(ObjectMaterial=object_material.ObjectMaterial)  # -> graft(Render), ObjectMaterial, CastsShadows, ReceivesShadows
object_2 = ModelObject(Geometry=move_4.Geometry, Render=simplify(render.Render))  # -> flatten(Object), Geometry, Name, Layer, Visibility, Display, Drafting
graft = GraftTree(Tree=object_2.Object, IncludeEmptyLists=True, IncludeNullItems=True)
item_4 = ListItem(List=flatten(object_2.Object), Index=1, Wrap=True)
cache_2 = ContentCache(Content=object_2.Object, Action=int_4)
panel_4 = Panel(item_3)
